# Dynamo graph Group Tags.dyn "Move Tags" (Dynamo 3.0.3.7597)

select_model_elements = DSModelElementsSelection()  # 14 picked in the model; graph input
python_script = Python(IN[0]=select_model_elements)  # CPython3
# ---------- python_script.python (44 lines) ----------
import clr
clr.AddReference("RevitAPI")
clr.AddReference("RevitServices")
from Autodesk.Revit.DB import *
from RevitServices.Persistence import DocumentManager
from RevitServices.Transactions import TransactionManager
doc = DocumentManager.Instance.CurrentDBDocument


# Load the Python Standard and DesignScript Libraries
import sys
import clr
clr.AddReference('ProtoGeometry')
from Autodesk.DesignScript.Geometry import *
o=1
# The inputs to this node will be stored as a list in the IN variables.
e = UnwrapElement(IN[0])
e = [ee for ee in e if isinstance(ee,IndependentTag)]
#l=e[0].TagHeadPosition
#t=e[0].TagText
#if isinstance(l, LocationPoint):

tag_positions={}


    #move_vec = src_pt - tgt_pt

        #ElementTransformUtils.MoveElement(doc, target_tag.Id, move_vec)
# Place your code below this line
TransactionManager.Instance.EnsureInTransaction(doc) 
for el in e:
    #pass
    tag_text=el.TagText
    if tag_text in tag_positions:
        position=tag_positions[tag_text]
        el.TagHeadPosition=position
    else:
        tag_positions[tag_text]=el.TagHeadPosition
# Assign your output to the OUT 

TransactionManager.Instance.TransactionTaskDone()


OUT = tag_positions#[el.Location.Point for el in e]
# ----------------------------------------
duct_insulation = Python()  # CPython3; frozen; unwired: IN[0]
# ---------- duct_insulation.python (143 lines) ----------
import clr
clr.AddReference("RevitAPI")
clr.AddReference("RevitServices")

from Autodesk.Revit.DB import *
from Autodesk.Revit.DB.Mechanical import *
from RevitServices.Persistence import DocumentManager
from RevitServices.Transactions import TransactionManager
doc = DocumentManager.Instance.CurrentDBDocument


def find_top_parent(el):
    # Base case: if element is not a FamilyInstance or has no parent, return it
    if not el.HostElementId:
        return None
    # Recursive case: go up to parent
    return (doc.GetElement(el.HostElementId))

def get_all_duct_insulation(doc):
    """Collect all insulation elements attached to duct elements."""
    collector = FilteredElementCollector(doc).OfClass(DuctInsulation)
    return list(collector)


def get_param_value(element, param_name):
    """Get parameter value as string or None."""
    p = element.LookupParameter(param_name)
    if p:
        if p.StorageType == StorageType.String:
            return p.AsString()
        else:
            return p.AsValueString()
    return None


def set_param_value(element, param_name, value):
    """Set string parameter value."""
    p = element.LookupParameter(param_name)
    #return p
    if p and p.StorageType == StorageType.String:
        p.Set(str(value))
        return p
        


def calculate_quantity(ins):
    """
    Determine quantity based on unit type:
      - "м." or "м"  → length (m)
      - "м²" or "м2" → area (m2)
      - "м³" or "м3" → volume (m3)
      - "шт"         → 1
    """
    doc = ins.Document
    ins_type = doc.GetElement(ins.GetTypeId())

    unit_str = get_param_value(ins_type, "ADSK_Единица измерения")
    if not unit_str:
        return None

    unit_str = unit_str.lower().replace(" ", "")

    # ---- Length (meters) ----
    if "м." in unit_str or unit_str == "м":
        length_ft = ins.get_Parameter(BuiltInParameter.CURVE_ELEM_LENGTH).AsDouble()
        return length_ft * 0.3048   # ft → m

    # ---- Area (square meters) ----
    if "м²" in unit_str or "м2" in unit_str:
        area_ft2=0
        area_ft2parameter = ins.LookupParameter("Area")
        if area_ft2parameter:
            #area_ft2=parent
            area_ft2=area_ft2parameter.AsDouble()
            if area_ft2==0:
                parent=find_top_parent(ins)
                if parent:
                    area_p_ft2parameter = parent.LookupParameter("ADSK_Размер_Площадь")
                    if area_p_ft2parameter:
                        area_ft2=area_p_ft2parameter.AsDouble()
                        #area_ft2=parent
            
        #area_ft2=ins.GetMaterialArea()
        return area_ft2 * 0.092903  # ft2 → m2

    # ---- Volume (cubic meters) ----
    if "м³" in unit_str or "м3" in unit_str:
        vol_ft3 = ins.LookupParameter("Volume").AsDouble()
        return vol_ft3 * 0.0283168  # ft3 → m3

    # ---- Each (шт) ----
    if "шт" in unit_str:
        return 1

    return None


def process_insulation(doc,ins):
    """Main function to process all insulation."""

    

    
    out=[]
    doc = ins.Document
    ins_type = doc.GetElement(ins.GetTypeId())

    # --- 1. Copy Type Comment → ADSK_Наименование ---
    #type_comment = get_param_value(ins_type, "Type Comments")
    type_comment = get_param_value(ins_type, "Type Comments")
    if type_comment:
        set_param_value(ins, "ADSK_Наименование", type_comment)
        

    # --- 2. Calculate quantity ---
    qty = calculate_quantity(ins)

    # Write quantity into ADSK_Количество (if exists)
    if qty is not None:
        p_qty = ins.LookupParameter("ADSK_Количество")
        out.append(qty)
        if p_qty:# and p_qty.StorageType == StorageType.Double:
            p_qty.Set(qty)
    set_param_value(ins, "ADSK_Наименование", type_comment)

    

    return out
    
    

    
TransactionManager.Instance.EnsureInTransaction(doc)  
        
out=[]
ins_list = get_all_duct_insulation(doc)
for ins in ins_list:
    out.append(process_insulation(doc,ins))
        
TransactionManager.Instance.TransactionTaskDone()
        
OUT=out
    
# ----------------------------------------
